# Grasshopper definition assembly_design.ghx (Grasshopper 1.0.8)
# plug-ins: RhinoCodePluginGH

# ----
# Brick geometries
mesh = Mesh(<mesh referenced from the Rhino model>)
insulated_brick = Python3Script(mesh=mesh, length="0.12", width="0.245", height="0.070")  # -> out, brick_insulated; inputs mesh: Mesh, length: Double, width: Double, height: Double
# ---------- insulated_brick: Python ----------
from compas.geometry import Frame
from compas.geometry import Vector
from compas.geometry import Box
from compas_rhino.conversions import mesh_to_compas, frame_to_rhino_plane, frame_to_rhino
from climate_active_envelopes.assembly import CAEPart as Part


centre_frame = Frame([0., 0., 0.], [1, 0, 0], [0, 1, 0]) #center of the box frame 
brick_geometry_insulated = Box(width, length, height, centre_frame)
brick_insulated = Part.from_shape(brick_geometry_insulated)

#brick_geometry_insulated = mesh_to_compas(mesh)
#brick_insulated = Part.from_mesh(brick_geometry_insulated)
# ---------- end insulated_brick ----------
full_brick = Python3Script(length="0.11", width="0.235", height="0.070")  # -> out, brick_full; inputs length: Double, width: Double, height: Double
# ---------- full_brick: Python ----------
from compas.geometry import Frame
from compas.geometry import Vector
from compas.geometry import Box
from climate_active_envelopes.assembly import CAEPart as Part


# create part
centre_frame = Frame([0., 0., 0.], [1, 0, 0], [0, 1, 0]) #center of the box frame 
brick_geometry_full = Box(width, length, height, centre_frame)
brick_full = Part.from_shape(brick_geometry_full)
print(brick_full.__data__)

#full_brick = Part.from_shape(full_brick_geometry, name="full_brick", frame=center_frame)
#insulated_brick = Part.from_shape(full_brick_geometry, name="insulated_brick", frame=center_frame)
# ---------- end full_brick ----------
list = ValueList({"none", "full", "insulated"}, selected="full")
parts = Python3Script(brick_full=full_brick.brick_full, brick_insulated=insulated_brick.brick_insulated, show=list)  # -> out, rhino_plane, rhino_mesh; inputs show: String
# ---------- parts: Python ----------
from compas_rhino.conversions import mesh_to_rhino, box_to_rhino, frame_to_rhino
from climate_active_envelopes.assembly import CAEPart as Part
from compas.geometry import Frame
from compas.geometry import Vector
from compas.geometry import Box


if show=="full":

    #extract the mesh of the part for visulization
    compas_mesh_full = brick_full.mesh

    #convert to rhino mesh
    rhino_mesh = mesh_to_rhino(compas_mesh_full)
    
    #extract and convert to rhino plane
    rhino_plane = frame_to_rhino(brick_full.frame)

    #brick_full.gripping_frame = brick_full.frame
    #print(brick_full.__data__)
    print(type(brick_full))

    

elif show == "insulated":

    #extract the mesh of the part for visulization
    compas_mesh_insulated = brick_insulated.mesh

    #convert to rhino mesh
    rhino_mesh = mesh_to_rhino(compas_mesh_insulated)
    
    #extract and convert to rhino plane
    rhino_plane = frame_to_rhino(brick_insulated.frame)

else:
    pass
# ---------- end parts ----------
pln = Plane(parts.rhino_plane)
geo = Geometry(parts.rhino_mesh)

# ----
# Create contour curves from mesh
point = Point(<point referenced from the Rhino model>)
# Input: mesh only!
# Point selection based to
# the mesh location
mesh_2 = Mesh(<mesh referenced from the Rhino model>)
unit_z = UnitZ(Factor=1)
dist = Slider(0.07, range=0..1)
contour = Contour(Shape=mesh_2, Point=point, Direction=unit_z, Distance=dist)
curve = Curve(flatten(contour))
custom_preview = CustomPreview(Geometry=[mesh_2, curve], Material=ColourSwatch(SwatchColor=RGBA(255, 59, 59, 62)))

# ----
# Unload Python modules
button = Button()
unload = Python3Script(unload=button)  # -> out, a
# ---------- unload: Python ----------
from compas_rhino import unload_modules

unload_modules('climate_active_envelopes.assembly')
unload_modules('climate_active_envelopes.part')
# ---------- end unload ----------

# ----
# Create empty assembly datastructure
button_2 = Button()
assembly = Python3Script(init=button_2)  # -> out, my_assembly
# ---------- assembly: Python ----------
from climate_active_envelopes.assembly import CAEAssembly as Assembly

#create empty assembly
my_assembly = Assembly()
# ---------- end assembly ----------

# ----
# exchange transformation
# based on the values from the radiation map!
mesh_to_brep = Python3Script(mesh=mesh_2)  # -> brep
# ---------- mesh_to_brep: Python ----------
from Rhino.Geometry import Brep

brep = Brep.CreateFromMesh(mesh, True)
# ---------- end mesh_to_brep ----------
# add / internalize an
# architectural context!
flip = Flip(Surface=mesh_to_brep)  # -> Surface, Result
architectural_context = Brep(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)
input_wall = Brep(flip.Surface)
path = FilePath("C:\Users\julia\Downloads\DEU_BY_Munich-Theresienwiese.108650_TMYx\DEU_BY_Munich-Theresienwiese.108650_TMYx.epw")
radiation_profile = RadiationProfile(
    start_month=Slider(3, range=0..10),
    start_day=Slider(1, range=0..10),
    start_hour=Slider(11, range=0..100),
    end_month=Slider(8, range=0..10),
    end_day=Slider(31, range=0..100),
    end_hour=Slider(16, range=0..100),
    north="0",
    geometry=input_wall,
    epw_file=path,
    context=architectural_context,
    grid_size=Slider(0.2, range=0..1),
    offset_dist=Slider(0.2, range=0..1),
    run=Toggle(True))  # -> points, results, mesh
mesh_3 = Mesh(radiation_profile.mesh)
vals = Python3Script(results=radiation_profile.results)  # -> out, color_values; inputs results: list
# ---------- vals: Python ----------
from compas.itertools import normalize_values


color_values = normalize_values(results, 0.0, 0.05)
print(color_values)




"""
color_points = []

for i, point in enumerate(points):
    frame = Frame([color_values[i], point[1] , point[2]], [1,0,0], [0,1,0])
    
    color_points.append(frame.point)
"""
# ---------- end vals ----------
panel = Panel(vals.color_values)

# ----
# Create brick wall
list_2 = ValueList({"flemish_bond": 0, "other_bond": 1, "other_bond_archive": 2, "cross_bond": 3, "french_bond": 4}, selected="french_bond")
# create assembly at the mesh's location
# and not next to it!
create_brick_assembly = Python3Script(
    bond=list_2,
    my_assembly=assembly.my_assembly,
    brick_full=full_brick.brick_full,
    brick_insulated=insulated_brick.brick_insulated,
    plane=pln,
    lines=curve)  # -> out, my_assembly, total_length; inputs plane: Plane, lines: list of Line
# ---------- create_brick_assembly: Python ----------
import math
import Rhino.Geometry as rg
from compas.geometry import Frame, Point, Vector
from compas.geometry import Transformation, Rotation, Translation
import compas.geometry as cg
from compas_rhino.conversions import plane_to_compas_frame, point_to_compas

total_length = my_assembly.generate_wall(bond,
                        brick_full, 
                        brick_insulated,
                        plane,
                        lines
                        )
# ---------- end create_brick_assembly ----------
# User needs to
# * choose different bond types
# * choose the bricks' transformation
total_length = Panel(create_brick_assembly.total_length)

# ----
# Image sampler - Gradient mapping
get_centroids = Python3Script(my_assembly=create_brick_assembly.my_assembly)  # -> out, my_assembly, values, keys, z_values, x_values, y_values
# ---------- get_centroids: Python ----------
from compas.geometry import Frame, Translation, Rotation, Transformation, Point
from compas_rhino.conversions import plane_to_compas_frame, point_to_compas

import math
import Rhino.Geometry as rg



values = []
keys = []
z_values = []
x_values = []
y_values = []

for key in my_assembly.graph.nodes_where({"fixed": False}):
    part = my_assembly.part(key)
    print(type(part))
    compas_point = part.frame.point
    rhino_point = rg.Point3d(compas_point.x, compas_point.y, compas_point.z)
    values.append(rhino_point)
    x_values.append(rhino_point.X)
    z_values.append(rhino_point.Z)
    y_values.append(rhino_point.Y)
    keys.append(key)

my_assembly = my_assembly
# ---------- end get_centroids ----------
zs = Bounds(Numbers=get_centroids.z_values)
xs = Bounds(Numbers=get_centroids.x_values)
rnz = RemapNumbers(Value=get_centroids.z_values, Source=zs, Target=Domain(0, 1))  # -> Mapped, Clipped
rnx = RemapNumbers(Value=get_centroids.x_values, Source=xs, Target=Domain(0, 1))  # -> Mapped, Clipped
cp = ConstructPoint(XCoordinate=rnx.Mapped, YCoordinate=rnz.Mapped, ZCoordinate=get_centroids.y_values)
image_sampler = ImageSampler(cp, Filter="Value", Interpolate=False, Umax=1, Umin=0, Vmax=1, Vmin=0, Wrap=0)

# ----
# Apply Gradient
toggle = BooleanToggle(False)
apply_gradient = Python3Script(my_assembly=get_centroids.my_assembly, transform=toggle, values=image_sampler, keys=get_centroids.keys)  # -> out, my_assembly; inputs values: list, keys: list
# ---------- apply_gradient: Python ----------
import math
import Rhino.Geometry as rg
from compas.geometry import Frame, Point
from compas.geometry import Transformation, Rotation, Translation

if transform:
    assembly = my_assembly
    my_assembly.apply_gradient(transform, values, keys)
# ---------- end apply_gradient ----------

pt = Point(radiation_profile.points)

# ----
# Transform
toggle_2 = BooleanToggle(True)
pln_2 = Plane(PlaneXY(2.43007085, -1.968439302, -0.2055923429))
transform = Python3Script(my_assembly=apply_gradient.my_assembly, transform=toggle_2, origin_plane=pln, new_origin_plane=pln_2)  # -> out, my_assembly
# ---------- transform: Python ----------
from compas.geometry import Frame, Transformation, Rotation, Translation
from compas_rhino.conversions import plane_to_compas_frame


new_origin_frame = plane_to_compas_frame(new_origin_plane)
origin_frame = plane_to_compas_frame(origin_plane)

if transform:
    T = Transformation.from_frame_to_frame(origin_frame, new_origin_frame)
    my_assembly = my_assembly.transformed(T)
# ---------- end transform ----------

# ----
# Visualise Image Sampler
bounds = Bounds(Numbers=image_sampler)
dd = DeconstructDomain(Domain=bounds)  # -> Start, End
gradient = Gradient(LowerLimit=dd.Start, UpperLimit=dd.End, Parameter=image_sampler, stops=[0.328: RGB(0, 0, 0), 1: RGB(255, 255, 255)])
custom_preview_2 = CustomPreview(Geometry=get_centroids.values, Material=gradient)

# ----
# Export to JSON
path_2 = Python3Script()  # -> HERE, DATA, ASSEMBLY
# ---------- path_2: Python ----------
import os

HERE = os.path.dirname(ghdoc.Path)
DATA = os.path.abspath(os.path.join(HERE, "..", "data"))
ASSEMBLY = os.path.abspath(os.path.join(DATA, "assembly"))

print(HERE)
print(DATA)
print(ASSEMBLY)
# ---------- end path_2 ----------
export = Button()
export_2 = Python3Script(ASSEMBLY=path_2.ASSEMBLY, my_assembly=transform.my_assembly, export=export)  # -> out; inputs ASSEMBLY: String
# ---------- export_2: Python ----------
import os

#print(my_assembly.__data__)
if export:
    #print(DATA)
    filename = "brickwall_2x2_full_and_insulated.json"
    PATH = os.path.join(ASSEMBLY, filename)

    # the assembly has to be serialized such that it can be called from CPython
    my_assembly.to_json(PATH)
# ---------- end export_2 ----------

reset = Button()
back = Button()
start = Button()
stop = Button()
step = Button()
full = Button()
list_3 = ValueList({"20", "50", "100", "500", "1000", "5000"}, selected="500")
counter = Python3Script(
    my_assembly=create_brick_assembly.my_assembly,
    start=start,
    stop=stop,
    step=step,
    step_back=back,
    reset=reset,
    full=full,
    interval=list_3)  # -> out, counter
# ---------- counter: Python ----------
from scriptcontext import sticky as st
import Grasshopper

def update_component(ghenv, delay):
    """Schedule an update of the Grasshopper component.

    After the specified delay, the GH component will be automatically updated.

    Parameters
    ----------
    ghenv : :class:`GhPython.Component.PythonEnvironment`
        The current GHPython environment.
    delay : :obj:`int`
        Time in milliseconds until the update is performed.

    Raises
    ------
    ValueError
        If the delay is less than zero.

    """
    if delay <= 0:
        raise ValueError("Delay must be greater than zero")

    ghcomp = ghenv.Component
    ghdoc = ghcomp.OnPingDocument()

    def callback(ghdoc):
        if ghdoc.SolutionState != Grasshopper.Kernel.GH_ProcessStep.Process:
            ghcomp.ExpireSolution(False)

    ghdoc.ScheduleSolution(delay, Grasshopper.Kernel.GH_Document.GH_ScheduleDelegate(callback))

L = range(my_assembly.graph.number_of_nodes())

# store data in component
guid = str(ghenv.Component.InstanceGuid)
counter_key = "counter_" + guid
running_key = "running_" + guid

if counter_key not in st:
    st[counter_key] = 0

if running_key not in st:
    st[running_key] = False
    

if st[running_key]:
    if st[counter_key] < len(L) - 1:
        st[counter_key] += 1
        update_component(ghenv, interval)
    else:
        st[counter_key] = 0
        st[running_key] = False
    
if start:
    st[running_key] = True

if stop:
    st[running_key] = False

if step:
    if st[counter_key] < len(L) - 1:
        st[counter_key] += 1

if step_back:
    if st[counter_key] < len(L) - 1:
        st[counter_key] -= 1

if reset:
    st[counter_key] = 0
    st[running_key] = False

if full:
    st[counter_key] = len(L)-1

if len(L):
    item = L[st[counter_key]]


#st["visualisation_counter"] = st[counter_key]
counter = st[counter_key]+1
# ---------- end counter ----------
panel_2 = Panel(counter.counter)

# ----
# Visualisation Dashboard
toggle_3 = BooleanToggle(True)
list_4 = ValueList({"show all": "show_all", "show until key": "show_until_key"}, selected="show all")
visualize = Python3Script(my_assembly=apply_gradient.my_assembly, show=list_4, highlight_current_part=toggle_3, counter=panel_2)  # -> out, parts_geometry, parts_frame, current_part_geometry, current_part_frame, current_part_gripping_frame
# ---------- visualize: Python ----------
from compas_rhino.conversions import mesh_to_rhino, box_to_rhino, frame_to_rhino

#print assembly
print(my_assembly)
#counter = int(counter)

#get parts datastructure
parts = [p for p in my_assembly.parts()]

#get current part



if show == "show_all":
    
#get parts datastructure
    parts = [p for p in my_assembly.parts()]
    parts_geometry = []
    parts_frame = []

    #part = parts[0]
    #print(part.gripping_frame)

    #extract the mesh of the parts for visulization (+ converted to rhino mesh)
    parts_geometry = [mesh_to_rhino(p.mesh) for p in parts]
    
    #extract the frame of the parts for visulization (+ converted to rhino plane)
    parts_frame = [frame_to_rhino(p.frame) for p in parts]
    #print(parts_geometry)

    key = my_assembly.graph.number_of_nodes()-1

if show == "show_until_key":
    #extract the mesh of the parts for visulization (+ converted to rhino mesh)
    parts_geometry = [mesh_to_rhino(p.mesh) for p in parts[0:int(counter)]]
    
    #extract the frame of the parts for visulization (+ converted to rhino plane)
    parts_frame = [frame_to_rhino(p.frame) for p in parts[0:int(counter)]]

    key = int(counter)-1

if highlight_current_part:
    current_part = my_assembly.part(key)
    current_part_geometry = mesh_to_rhino(current_part.mesh)
    current_part_frame = frame_to_rhino(current_part.frame)
    current_part_gripping_frame = frame_to_rhino(current_part.gripping_frame)
    
    print(current_part.__data__)
# ---------- end visualize ----------
panel_3 = Panel(visualize.out)
geo_2 = Geometry(visualize.parts_geometry)
geo_3 = Geometry([visualize.current_part_frame, visualize.current_part_geometry])
geo_4 = Geometry(visualize.parts_frame)
preview = CustomPreview(Geometry=geo_2, Material=ColourSwatch(SwatchColor=RGB(196, 141, 141)))
preview_2 = CustomPreview(Geometry=geo_4, Material=ColourSwatch(SwatchColor=RGB(255, 125, 157)))
preview_3 = CustomPreview(Geometry=geo_3, Material=ColourSwatch(SwatchColor=RGB(255, 125, 157)))

geo_5 = Geometry(visualize.current_part_gripping_frame)
preview_4 = CustomPreview(Geometry=geo_5, Material=ColourSwatch(SwatchColor=RGB(255, 125, 157)))
draw = Python3Script(planes=geo_5, scale=Slider(0.2, range=0..1))  # -> out, P, V, C, W; inputs planes: list of Plane
# ---------- draw: Python ----------
from System.Drawing import Color

red = Color.FromArgb(255, 0, 0)
green = Color.FromArgb(0, 255, 0)
blue = Color.FromArgb(0, 0, 255)

P = []
V = []
C = []

scale = float(scale)

for plane in planes:
    if not plane:
        continue
    P += [plane.Origin] * 3
    V.append(plane.XAxis * scale)
    V.append(plane.YAxis * scale)
    V.append(plane.ZAxis * scale)
    C += [red, green, blue]

W = 3
# ---------- end draw ----------
vdisex = VectorDisplayEx(Point=draw.P, Vector=draw.V, Colour=draw.C, Width=draw.W)

# ==== cluster RadiationProfile
epw_file = ClusterInput()
start_month = ClusterInput()
start_day = ClusterInput()
start_hour = ClusterInput()
end_month = ClusterInput()
end_day = ClusterInput()
end_hour = ClusterInput()
importepw = LBImportEPW(epw_file=epw_file)  # -> location, dry_bulb_temperature, dew_point_temperature, relative_humidity, wind_speed, wind_direction, direct_normal_rad, diffuse_horizontal_rad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; plug-in component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
analysisperiod = LBAnalysisPeriod(
    start_month=start_month,
    start_day=start_day,
    start_hour=start_hour,
    end_month=end_month,
    end_day=end_day,
    end_hour=end_hour)  # -> period, hoys, dates; plug-in component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
north = ClusterInput()
skymatrix = LBCumulativeSkyMatrix(
    north=north,
    location=importepw.location,
    direct_rad=importepw.direct_normal_rad,
    diffuse_rad=importepw.diffuse_horizontal_rad,
    hoys=analysisperiod.hoys)  # -> report, sky_mtx; plug-in component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
colrange = LBColorRange(index=Slider(22, range=0..100))  # -> colors; plug-in component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
geometry = ClusterInput()
context = ClusterInput()
grid_size = ClusterInput()
offset_dist = ClusterInput()
run = ClusterInput()
legendpar = LBLegendParameters(colors=colrange)  # -> leg_par; plug-in component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
incidentradiation = LBIncidentRadiation(
    sky_mtx=skymatrix.sky_mtx,
    geometry=flatten(geometry),
    context=flatten(context),
    grid_size=grid_size,
    offset_dist=offset_dist,
    legend_par=legendpar,
    run=run)  # -> report, points, results, total, mesh, legend, title, int_mtx; plug-in component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
points = ClusterOutput(incidentradiation.points)
results = ClusterOutput(incidentradiation.results)
mesh = ClusterOutput(incidentradiation.mesh)
